# Grasshopper definition spreefeld_cells.gh (Grasshopper 1.0.8)

# ----
# TYPE FLOOR
# ROOMS POLYLINES
polylines = ModelObject([<model object referenced from the Rhino model> x35])

# ----
# DOORS, TRESHOLD,
# WINDOWS POINTS
points = ModelObject([<model object referenced from the Rhino model> x34])

# ----
# GROUND FLOOR
# ROOMS POLYLINES
polylines_2 = ModelObject([<model object referenced from the Rhino model> x25])

# ----
# DOORS, TRESHOLD,
# WINDOWS POINTS
points_2 = ModelObject([<model object referenced from the Rhino model> x37])

group = GroupContent(Content=polylines)  # -> Content, graft(Values)

panel = Panel(group.Values)
space = Panel("::")
split = TextSplit(Text=panel, Separators=space)
panel_2 = Panel("3")
item = ListItem(List=split, Index=Slider(5, range=0..10), Wrap=True)  # -> simplify(Item)
number_slider = Slider(0, range=0..10)
split_2 = TextSplit(Text=item, Separators="::")
item_2 = ListItem(List=split_2, Index="0", Wrap=True)  # -> simplify(Item)
split_3 = TextSplit(Text=item_2, Separators=" ")
item_3 = ListItem(List=split_3, Index="0", Wrap=True)  # -> simplify(Item)
panel_3 = Panel(item_3)

group_2 = GroupContent(Content=polylines_2)  # -> Content, graft(Values)

cls = Closed(Curve=group.Content)  # -> Closed, Periodic
int = Integer(cls.Closed)
subtraction = Subtraction(A=int, B=1)
ma = MassAddition(Input=flatten(subtraction))  # -> Result, PartialResults
if_0_all_curves_are_closed = Panel(ma.Result)

panel_4 = Panel(group_2.Values)
space_2 = Panel(" ")
split_4 = TextSplit(Text=panel_4, Separators=space_2)
item_4 = ListItem(List=split_4, Index="3", Wrap=True)

cls_2 = Closed(Curve=group_2.Content)  # -> Closed, Periodic
int_2 = Integer(cls_2.Closed)
subtraction_2 = Subtraction(A=int_2, B=1)
ma_2 = MassAddition(Input=flatten(subtraction_2))  # -> Result, PartialResults
if_0_all_curves_are_closed_2 = Panel(ma_2.Result)

Z = UnitZ(Factor=Slider(3, range=0..10))
extr = Extrude(Base=group.Content, Direction=Z)
Z_2 = UnitZ(Factor=Slider(3, range=0..10))
extr_2 = Extrude(Base=group_2.Content, Direction=Z_2)
number_slider_2 = Slider(0, range=0..10)
cap = CapHoles(Brep=extr)
cap_2 = CapHoles(Brep=extr_2)

# ----
# NAMES
lng = ListLength(List=cap_2)
series = Series(Start=0, Step=1, Count=lng)
format = Format(Format="{0}_{1:00}", Culture=127, Data0=item_4, Data1=series)

# ----
# NAMES
lng_2 = ListLength(List=cap)
series_2 = Series(Start=0, Step=1, Count=lng_2)
format_2 = Format(Format="{0}_{1:00}", Culture=127, Data0=panel_3, Data1=series_2)

panel_5 = Panel(panel_3)
panel_6 = Panel(format_2)

# ----
# ROOM CELLS
object = ModelObject(Geometry=simplify(cap), Name=simplify(format_2), Layer=simplify(panel_3))  # -> Object, Geometry, Name, Layer, Visibility, Display, Drafting, Render

# ----
# ROOM CELLS
object_2 = ModelObject(Geometry=simplify(cap_2), Name=simplify(format), Layer=simplify(item_4))  # -> Object, Geometry, Name, Layer, Visibility, Display, Drafting, Render

group_3 = GroupContent(Content=points)  # -> Content, graft(Values)
bang = ExplodeTree(Data=group_3.Content)  # -> Branch0, Branch1, Branch2
crv = Curve(polylines)
entwine = Entwine(Branch00=bang.Branch0, Branch01=bang.Branch1, FlattenInputs=True)
cir = Circle(Plane=entwine, Radius=Slider(0.4, range=0..1))  # -> graft(Circle)
ccx = CurveCurve(CurveA=flatten(crv), CurveB=cir)  # -> Points, ParamsA, ParamsB
clean = CleanTree(RemoveNulls=True, RemoveInvalid=True, RemoveEmpty=invert(False), Tree=ccx.Points)
item_5 = ListItem(List=clean, Index=0, Wrap=True)  # -> Item, Item1
Z_3 = UnitZ(Factor=Slider(2.1, range=0..10))
panel_7 = Panel(clean)
ln = Line(StartPoint=item_5.Item, EndPoint=item_5.Item1)
extr_3 = Extrude(Base=ln, Direction=Z_3)
area = Area(Geometry=extr_3)  # -> Area, Centroid
cullpt = CullDuplicates(Points=area.Centroid, Tolerance=0.1, CullMode=1)  # -> Points, Indices, Valence
cull_i = CullIndex(List=extr_3, Indices=cullpt.Indices, Wrap=True)  # -> simplify(List)
brep = Brep(cull_i)
trim = TrimTree(Tree=brep, Depth=Slider(2, range=0..10))  # -> simplify(Tree)
panel_8 = Panel("""1
0""")
cull = CullPattern(List=trim, CullPattern=panel_8)

number_slider_3 = Slider(0.4, range=0..1)  # disabled
cir_2 = Circle(Plane=bang.Branch2, Radius=number_slider_3)  # -> graft(Circle); disabled
ccx_2 = CurveCurve(CurveA=flatten(crv), CurveB=cir_2)  # -> Points, ParamsA, ParamsB; disabled
number_slider_4 = Slider(2.1, range=0..10)  # disabled
clean_2 = CleanTree(RemoveNulls=True, RemoveInvalid=True, RemoveEmpty=invert(False), Tree=ccx_2.Points)  # disabled
number_slider_5 = Slider(1, range=0..1)  # disabled
item_6 = ListItem(List=clean_2, Index=0, Wrap=True)  # -> Item, Item1; disabled
Z_4 = UnitZ(Factor=number_slider_4)  # disabled
Z_5 = UnitZ(Factor=number_slider_5)  # disabled
ln_2 = Line(StartPoint=item_6.Item, EndPoint=item_6.Item1)  # disabled
subtraction_3 = Subtraction(A=Z_4, B=Z_5)  # disabled
move = Move(Geometry=ln_2, Motion=Z_5)  # -> Geometry, Transform; disabled
extr_4 = Extrude(Base=move.Geometry, Direction=subtraction_3)  # disabled
area_2 = Area(Geometry=extr_4)  # -> Area, Centroid; disabled
cullpt_2 = CullDuplicates(Points=area_2.Centroid, Tolerance=0.1, CullMode=1)  # -> Points, Indices, Valence; disabled
cull_i_2 = CullIndex(List=extr_4, Indices=cullpt_2.Indices, Wrap=True)  # -> simplify(List); disabled
brep_2 = Brep(flatten(cull_i_2))  # disabled

panel_9 = Panel(trim)

panel_10 = Panel(group_3.Values)
space_3 = Panel("::")
split_5 = TextSplit(Text=panel_10, Separators=space_3)
item_7 = ListItem(List=split_5, Index="3", Wrap=True)  # -> simplify(Item)
split_6 = TextSplit(Text=item_7, Separators="::")
item_8 = ListItem(List=split_6, Index="0", Wrap=True)  # -> simplify(Item)

split_7 = TextSplit(Text=item_8, Separators=" ")
item_9 = ListItem(List=split_7, Index="0", Wrap=True)  # -> simplify(Item)

bang_2 = ExplodeTree(Data=item_9)  # -> Branch0, Branch1, Branch2
panel_11 = Panel(bang_2.Branch0)
entwine_2 = Entwine(Branch00=bang_2.Branch0, Branch01=bang_2.Branch1, FlattenInputs=True)  # -> simplify(Result)

panel_12 = Panel(entwine_2)

txt = Text(panel_12)

# ----
# DOORS AND TRESHOLDS
object_3 = ModelObject(Geometry=simplify(trim), Layer=simplify(txt))  # -> Object, Geometry, Name, Layer, Visibility, Display, Drafting, Render

# ----
# WINDOWS
object_4 = ModelObject(Geometry=flatten(brep_2), Layer=flatten(bang_2.Branch2))  # -> Object, Geometry, Name, Layer, Visibility, Display, Drafting, Render; disabled

group_4 = GroupContent(Content=points_2)  # -> Content, graft(Values)
bang_3 = ExplodeTree(Data=group_4.Content)  # -> Branch0, Branch1
crv_2 = Curve(polylines_2)
entwine_3 = Entwine(Branch00=bang_3.Branch0, Branch01=bang_3.Branch1, FlattenInputs=True)
cir_3 = Circle(Plane=entwine_3, Radius=Slider(0.4, range=0..1))  # -> graft(Circle)
ccx_3 = CurveCurve(CurveA=flatten(crv_2), CurveB=cir_3)  # -> Points, ParamsA, ParamsB
clean_3 = CleanTree(RemoveNulls=True, RemoveInvalid=True, RemoveEmpty=invert(False), Tree=ccx_3.Points)
item_10 = ListItem(List=clean_3, Index=0, Wrap=True)  # -> Item, Item1
Z_6 = UnitZ(Factor=Slider(2.1, range=0..10))
panel_13 = Panel(clean_3)
ln_3 = Line(StartPoint=item_10.Item, EndPoint=item_10.Item1)
extr_5 = Extrude(Base=ln_3, Direction=Z_6)
area_3 = Area(Geometry=extr_5)  # -> Area, Centroid
cullpt_3 = CullDuplicates(Points=area_3.Centroid, Tolerance=0.1, CullMode=1)  # -> Points, Indices, Valence
cull_i_3 = CullIndex(List=extr_5, Indices=cullpt_3.Indices, Wrap=True)  # -> simplify(List)
brep_3 = Brep(cull_i_3)
trim_2 = TrimTree(Tree=brep_3, Depth=Slider(2, range=0..10))  # -> simplify(Tree)

panel_14 = Panel(group_4.Values)
space_4 = Panel(" ")
split_8 = TextSplit(Text=panel_14, Separators=space_4)
item_11 = ListItem(List=split_8, Index="3", Wrap=True)  # -> simplify(Item)
split_9 = TextSplit(Text=item_11, Separators="_")
item_12 = ListItem(List=split_9, Index="0", Wrap=True)  # -> simplify(Item)
bang_4 = ExplodeTree(Data=item_12)  # -> _00000, Branch1, Branch2
entwine_4 = Entwine(Branch00=bang_4._00000, Branch01=bang_4.Branch1, FlattenInputs=True)  # -> simplify(Result)
panel_15 = Panel(bang_4.Branch2)

cir_4 = Circle(Plane=PlaneXY(0, 0, 0), Radius=Slider(0.4, range=0..1))  # -> graft(Circle)
ccx_4 = CurveCurve(CurveA=flatten(crv_2), CurveB=cir_4)  # -> Points, ParamsA, ParamsB
clean_4 = CleanTree(RemoveNulls=True, RemoveInvalid=True, RemoveEmpty=invert(False), Tree=ccx_4.Points)
item_13 = ListItem(List=clean_4, Index=0, Wrap=True)  # -> Item, Item1
Z_7 = UnitZ(Factor=Slider(2.1, range=0..10))
Z_8 = UnitZ(Factor=Slider(1, range=0..1))
ln_4 = Line(StartPoint=item_13.Item, EndPoint=item_13.Item1)
subtraction_4 = Subtraction(A=Z_7, B=Z_8)
move_2 = Move(Geometry=ln_4, Motion=Z_8)  # -> Geometry, Transform
extr_6 = Extrude(Base=move_2.Geometry, Direction=subtraction_4)
area_4 = Area(Geometry=extr_6)  # -> Area, Centroid
cullpt_4 = CullDuplicates(Points=area_4.Centroid, Tolerance=0.1, CullMode=1)  # -> Points, Indices, Valence
cull_i_4 = CullIndex(List=extr_6, Indices=cullpt_4.Indices, Wrap=True)  # -> simplify(List)
brep_4 = Brep(flatten(cull_i_4))

panel_16 = Panel(entwine_4)

panel_17 = Panel(trim_2)

# ----
# DOORS AND TRESHOLDS
object_5 = ModelObject(Geometry=trim_2, Layer=panel_16)  # -> Object, Geometry, Name, Layer, Visibility, Display, Drafting, Render

# ----
# WINDOWS
object_6 = ModelObject(Geometry=flatten(brep_4), Layer=flatten(bang_4.Branch2))  # -> Object, Geometry, Name, Layer, Visibility, Display, Drafting, Render
