# Grasshopper definition Polylines_to_Doors_Windows_Cells.gh (Grasshopper 1.0.8)

# ----
# ROOMS POLYLINES
polylines = ModelObject([<model object referenced from the Rhino model> x68])

# ----
# DOORS, TRESHOLD,
# WINDOWS POINTS
points = ModelObject([<model object referenced from the Rhino model> x59])

group_content = GroupContent(Content=polylines)  # -> Content, graft(Values)

panel = Panel(group_content.Values)
space = Panel(" ")
split = TextSplit(Text=panel, Separators=space)
item = ListItem(List=split, Index="3", Wrap=True)

cls = Closed(Curve=group_content.Content)  # -> Closed, Periodic
int = Integer(cls.Closed)
subtraction = Subtraction(A=int, B=1)
ma = MassAddition(Input=flatten(subtraction))  # -> Result, PartialResults
if_0_all_curves_are_closed = Panel(ma.Result)

Z = UnitZ(Factor=Slider(3, range=0..10))
extr = Extrude(Base=group_content.Content, Direction=Z)
cap = CapHoles(Brep=extr)

# ----
# NAMES
lng = ListLength(List=cap)
series = Series(Start=0, Step=1, Count=lng)
format = Format(Format="{0}_{1:00}", Culture=127, Data0=item, Data1=series)

panel_2 = Panel("Doors")
panel_3 = Panel("""True
False""")

# ----
# ROOM CELLS
model_object = ModelObject(Geometry=cap, Name=format, Layer=item)  # -> Object, Geometry, Name, Layer, Visibility, Display, Drafting, Render

group_content_2 = GroupContent(Content=points)  # -> Content, graft(Values)
bang = ExplodeTree(Data=group_content_2.Content)  # -> Branch0, Branch1, Branch2
crv = Curve(polylines)
entwine = Entwine(Branch00=bang.Branch0, Branch01=bang.Branch1, FlattenInputs=True)
cir = Circle(Plane=entwine, Radius=Slider(0.4, range=0..1))  # -> graft(Circle)
ccx = CurveCurve(CurveA=flatten(crv), CurveB=cir)  # -> Points, ParamsA, ParamsB
clean = CleanTree(RemoveNulls=True, RemoveInvalid=True, RemoveEmpty=invert(False), Tree=ccx.Points)
item_2 = ListItem(List=clean, Index=0, Wrap=True)  # -> Item, Item1
Z_2 = UnitZ(Factor=Slider(2.1, range=0..10))
ln = Line(StartPoint=item_2.Item, EndPoint=item_2.Item1)
panel_4 = Panel(ln)
extr_2 = Extrude(Base=ln, Direction=Z_2)
area = Area(Geometry=extr_2)  # -> Area, Centroid
cullpt = CullDuplicates(Points=area.Centroid, Tolerance=0.1, CullMode=1)  # -> Points, Indices, Valence
cull_i = CullIndex(List=extr_2, Indices=cullpt.Indices, Wrap=True)  # -> simplify(List)
brep = Brep(cull_i)
trim = TrimTree(Tree=brep, Depth=Slider(2, range=0..10))  # -> simplify(Tree)

panel_5 = Panel(group_content_2.Values)
space_2 = Panel(" ")
split_2 = TextSplit(Text=panel_5, Separators=space_2)
item_3 = ListItem(List=split_2, Index="3", Wrap=True)  # -> simplify(Item)
split_3 = TextSplit(Text=item_3, Separators="_")
item_4 = ListItem(List=split_3, Index="0", Wrap=True)  # -> simplify(Item)
bang_2 = ExplodeTree(Data=item_4)  # -> Branch0, Branch1, Branch2
entwine_2 = Entwine(Branch00=bang_2.Branch0, Branch01=bang_2.Branch1, FlattenInputs=True)  # -> simplify(Result)
# WINDOWS
panel_6 = Panel(bang_2.Branch2)

cir_2 = Circle(Plane=bang.Branch2, Radius=Slider(0.4, range=0..1))  # -> graft(Circle)
ccx_2 = CurveCurve(CurveA=flatten(crv), CurveB=cir_2)  # -> Points, ParamsA, ParamsB
clean_2 = CleanTree(RemoveNulls=True, RemoveInvalid=True, RemoveEmpty=invert(False), Tree=ccx_2.Points)
item_5 = ListItem(List=clean_2, Index=0, Wrap=True)  # -> Item, Item1
Z_3 = UnitZ(Factor=Slider(2.1, range=0..10))
Z_4 = UnitZ(Factor=Slider(1, range=0..1))
ln_2 = Line(StartPoint=item_5.Item, EndPoint=item_5.Item1)
subtraction_2 = Subtraction(A=Z_3, B=Z_4)
move = Move(Geometry=ln_2, Motion=Z_4)  # -> Geometry, Transform
extr_3 = Extrude(Base=move.Geometry, Direction=subtraction_2)
area_2 = Area(Geometry=extr_3)  # -> Area, Centroid
cullpt_2 = CullDuplicates(Points=area_2.Centroid, Tolerance=0.1, CullMode=1)  # -> Points, Indices, Valence
cull_i_2 = CullIndex(List=extr_3, Indices=cullpt_2.Indices, Wrap=True)  # -> simplify(List)
brep_2 = Brep(flatten(cull_i_2))

panel_7 = Panel(entwine_2)

cull_pattern = CullPattern(List=trim, CullPattern=panel_3)
panel_8 = Panel(cull_pattern)
param_viewer = ParamViewer(cull_pattern)

# ----
# WINDOWS
model_object_2 = ModelObject(Geometry=flatten(brep_2), Layer=flatten(bang_2.Branch2))  # -> Object, Geometry, Name, Layer, Visibility, Display, Drafting, Render

# ----
# DOORS AND TRESHOLDS
model_object_3 = ModelObject(Geometry=cull_pattern, Layer=panel_7)  # -> Object, Geometry, Name, Layer, Visibility, Display, Drafting, Render
